# Dynamo custom node ShapelytoNumpy.dyf (Dynamo 2.17.0.3472)
# category: Shapely.Conversion

shgeometry = Input(_shgeometry: var[]..[])
python_script = Python(IN[0]=shgeometry)  # CPython3
# ---------- python_script.python (46 lines) ----------
#Copyright(c) 2023, Durmus Bayryam
# Gıthub : https://github.com/DurmusCesur/Shapely.git
import clr
import sys
import re
import System

clr.AddReference('Python.Included')
import Python.Included as pyInc
path_py3_lib = pyInc.Installer.EmbeddedPythonHome
sys.path.append(path_py3_lib + r'\Lib\site-packages')

import shapely.geometry as sg
from shapely.geometry import Polygon, MultiPolygon ,MultiLineString ,Point
import numpy as np

shapely_poly = []

def shapely_to_dynamo(shapely_geometry):
    dynamo_geometry = []
    if isinstance(shapely_geometry, sg.Point):
        points = ([shapely_geometry.x,shapely_geometry.y])
        dynamo_geometry = points
        
    elif isinstance(shapely_geometry, sg.LineString):
        points = list(shapely_geometry.coords)
        dynamo_geometry = points
        
    elif isinstance(shapely_geometry, sg.Polygon):
        exterior_points = list(shapely_geometry.exterior.coords)
        dynamo_geometry = exterior_points
        
    elif isinstance(shapely_geometry, sg.MultiPoint):
        points = shapely_geometry.coords
        dynamo_geometry.append(points)
        
    return np.array(dynamo_geometry, dtype=np.float32)

if isinstance(IN[0], list):
    dynamo_point = IN[0]
else:
    dynamo_point = [IN[0]]

dynamo_geometries = [shapely_to_dynamo(geo) for geo in dynamo_point]

OUT = dynamo_geometries
# ----------------------------------------
OUT = Output(python_script)
