# Dynamo custom node Shp_Buffer.dyf (Dynamo 3.4.1.7055)
# category: Shapely.Geometry.Creates
# author: Durmus Bayryam
# A shapely buffer creates a new geometry extended by a specified distance around a geometry (point, line or polygon). This operation adds a buffer zone around the geometry based on the given distance.

ShpGeometry = Input(_ShpGeometry: var[]..[])
Offset = Input(_Offset: var[]..[])
style = Input(_style: var[]..[])  # # 1:Round, 2:Mitre, 3:Bevel
python_script = Python(IN[0]=ShpGeometry, IN[1]=Offset, IN[2]=style)  # CPython3
# ---------- python_script.python (69 lines) ----------
# Shapely 2.0.1
# Durmus Bayram
import clr

try:
    from shapely.geometry import Point as ShpPoint
    from shapely.geometry import LineString as ShpLineString
    from shapely.geometry import Polygon as ShpPolygon
    from shapely.geometry import LinearRing as ShpLinearRing
    from shapely.geometry import MultiPoint as ShpMultiPoint
    from shapely.geometry import MultiLineString as ShpMultiLineString
    from shapely.geometry import MultiPolygon as ShpMultiPolygon
    from shapely.geometry import GeometryCollection as ShpGeometryCollection
    from shapely.geometry.base import BaseGeometry
except ImportError:
    print("\n Please install Shapely package!")
    pass

def shapely_generic_buffer(geom, distance, cap_style=1, join_style=1):
    if not isinstance(geom, BaseGeometry):
        return None
    
    try:
        if isinstance(geom, ShpPoint) and cap_style == 2:
            current_cap = 1
        else:
            current_cap = cap_style

        return geom.buffer(
            distance, 
            cap_style=current_cap, 
            join_style=join_style
        )
    except Exception as e:
        print("Buffer Error: " + str(e))
        return None

def get_shapely_buffer(shapely_geometry, distance, params, return_individual=False):
    
    if isinstance(shapely_geometry, list):
        return [get_shapely_buffer(item, distance, params, return_individual) for item in shapely_geometry]
    
    if isinstance(shapely_geometry, (ShpMultiPoint, ShpMultiLineString, ShpMultiPolygon, ShpGeometryCollection)):
        if return_individual:
            return [shapely_generic_buffer(g, distance, **params) for g in shapely_geometry.geoms]
        else:
            return shapely_generic_buffer(shapely_geometry, distance, **params)
    
    elif isinstance(shapely_geometry, BaseGeometry):
        return shapely_generic_buffer(shapely_geometry, distance, **params)
    
    else:
        return None

if 'IN' in locals():
    shp_input = IN[0]
    
    dist = IN[1] if IN[1] is not None else 0.0
    
    params = {
        "cap_style": 2, 
        "join_style": IN[2] if len(IN) > 2 and IN[2] is not None else 2,
    }
    
    return_indiv = IN[3] if len(IN) > 3 and IN[3] is not None else False
    
    buffer_output = get_shapely_buffer(shp_input, dist, params, return_individual=return_indiv)
    
    OUT = buffer_output
# ----------------------------------------
ShpGeometry_2 = Output(python_script)  # "_ShpGeometry"
