# Dynamo custom node Shp_Contains.dyf (Dynamo 3.4.1.7055)
# category: Shapely.Geometry.Operation
# author: Durmus Bayryam
# It checks whether one geometry completely encompasses the other. In other words, it checks whether the first geometry contains the second geometry.

ShpPolygon = Input(_ShpPolygon: var[]..[])
ShpGeometry = Input(_ShpGeometry: var[]..[])
python_script = Python(IN[0]=ShpPolygon, IN[1]=ShpGeometry)  # CPython3
# ---------- python_script.python (66 lines) ----------
# Shapely 2.0.1
# Durmus Bayram
import clr

try:
    from shapely.geometry import Point as ShpPoint
    from shapely.geometry import LineString as ShpLineString
    from shapely.geometry import Polygon as ShpPolygon
    from shapely.geometry import MultiPolygon as ShpMultiPolygon
    from shapely.geometry.base import BaseGeometry
    from shapely.prepared import prep 
    
except ImportError:
    print("\n Please install Shapely package!")
    pass


def prepare_geometry(geometry):
    if isinstance(geometry, BaseGeometry):
        return prep(geometry)
    return geometry 

def check_contains_prepared(prepared_container, other_geometry):
    
    if not hasattr(prepared_container, 'contains'):
        if isinstance(prepared_container, BaseGeometry):
            return prepared_container.contains(other_geometry)
        return False
    if not isinstance(other_geometry, BaseGeometry):
        return False
        
    return prepared_container.contains(other_geometry)

def get_shapely_contains_performance(container_input, other_input):
    if isinstance(container_input, BaseGeometry):
        prepared_container = prepare_geometry(container_input)
        
        if isinstance(other_input, list):
            return [check_contains_prepared(prepared_container, other) for other in other_input]
        else:
            return check_contains_prepared(prepared_container, other_input)
            
    elif isinstance(container_input, list):
        prepared_containers = [prepare_geometry(item) for item in container_input if isinstance(item, BaseGeometry)]
        
        if not isinstance(other_input, list):
            return [check_contains_prepared(prep_c, other_input) for prep_c in prepared_containers]
        elif isinstance(other_input, list):
            return [check_contains_prepared(prep_c, other) 
                    for prep_c, other in zip(prepared_containers, other_input)]
    return None

if 'IN' in locals():
    # IN[0] -> Container (Kapsayan Geometri veya Liste)
    # IN[1] -> Other (İçeride aranan Geometri veya Liste)
    
    container_input = IN[0]
    other_input = IN[1] if len(IN) > 1 else None
    
    if container_input is not None and other_input is not None:
        # 🚀 
        contains_output = get_shapely_contains_performance(container_input, other_input)
    else:
        contains_output = False
    
    OUT = contains_output
# ----------------------------------------
Boolean = Output(python_script)  # "_Boolean"
