# Dynamo custom node Shp_Perimeter.dyf (Dynamo 3.4.1.7055)
# category: Shapely.Geometry.Operation
# author: Durmus Bayryam
# Calculates the perimeter length around a polygon. This is the total length of the polygon's sides.

ShpGeometry = Input(_ShpGeometry: var[]..[])
python_script = Python(IN[0]=ShpGeometry)  # CPython3
# ---------- python_script.python (47 lines) ----------
# Shapely 2.0.1
# Durmus Bayram
import clr

try:
    from shapely.geometry import Polygon as ShpPolygon
    from shapely.geometry import MultiPolygon as ShpMultiPolygon
    from shapely.geometry import GeometryCollection as ShpGeometryCollection
    from shapely.geometry.base import BaseGeometry
    from shapely import get_exterior_ring
except ImportError:
    print("\n Please install Shapely package!")

def get_exterior_recursive(geom):
    results = []
    
    if hasattr(geom, 'geoms'):
        for sub_geom in geom.geoms:
            results.extend(get_exterior_recursive(sub_geom))
            
    elif isinstance(geom, ShpPolygon):
        results.append(get_exterior_ring(geom))
        
    return results

def get_shapely_Exteriorboundary(input_data, return_individual=False):
    if isinstance(input_data, list):
        return [get_shapely_Exteriorboundary(item, return_individual) for item in input_data]
    
    elif isinstance(input_data, BaseGeometry):
        boundaries = get_exterior_recursive(input_data)
        
        if not boundaries:
            return None
            
        if len(boundaries) == 1 and not return_individual:
            return boundaries[0]
            
        return boundaries

    return None

if 'IN' in locals():
    shapely_input = IN[0]
    indiv_mode = IN[1] if (len(IN) > 1 and IN[1] is not None) else False
    
    OUT = get_shapely_Exteriorboundary(shapely_input, indiv_mode)
# ----------------------------------------
ShpGeometry_2 = Output(python_script)  # "_ShpGeometry"
