# Dynamo custom node Shp_PerimeterInterior.dyf (Dynamo 3.4.1.7055)
# category: Shapely.Geometry.Operation
# author: Durmus Bayryam
# Calculates the inner boundaries (holes) and outer boundaries of a polygon. Inner boundaries are the voids within the polygon.

ShpGeometry = Input(_ShpGeometry: var[]..[])
python_script = Python(IN[0]=ShpGeometry)  # CPython3
# ---------- python_script.python (48 lines) ----------
# Shapely 2.0.1
# Durmus Bayram
import clr

try:
    from shapely.geometry import Point as ShpPoint
    from shapely.geometry import LineString as ShpLineString
    from shapely.geometry import Polygon as ShpPolygon
    from shapely.geometry import MultiPoint as ShpMultiPoint
    from shapely.geometry import MultiLineString as ShpMultiLineString
    from shapely.geometry import MultiPolygon as ShpMultiPolygon
    from shapely.geometry import GeometryCollection as ShpGeometryCollection
    from shapely.geometry import LinearRing
    from shapely.geometry.base import BaseGeometry
    from shapely import get_interior_ring, get_num_interior_rings
    
except ImportError:
    print("\n Please install Shapely package!")

def get_all_interiors(geom):
    holes = []
    
    if isinstance(geom, ShpPolygon):
        holes.extend(list(geom.interiors))
        
    elif isinstance(geom, ShpMultiPolygon):
        for poly in geom.geoms:
            holes.extend(list(poly.interiors))
            
    elif hasattr(geom, 'geoms'):
        for g in geom.geoms:
            holes.extend(get_all_interiors(g))
            
    return holes

def process_geometry_list(input_data):
    if isinstance(input_data, list):
        return [process_geometry_list(item) for item in input_data]
    
    elif isinstance(input_data, BaseGeometry):
        return get_all_interiors(input_data)
    
    return None

if 'IN' in locals():
    shp_input = IN[0]
    
    OUT = process_geometry_list(shp_input)
# ----------------------------------------
ShpGeometry_2 = Output(python_script)  # "_ShpGeometry"
