# Dynamo custom node Shp_SharedPaths.dyf (Dynamo 3.4.1.7055)
# category: Shapely.Geometry.Operation
# author: Durmus Bayryam
# Determines the common paths (or intersections of paths) between two geometries. This operation is used to find common edges or connections.

ShpGeometry = Input(_ShpGeometry: var[]..[])
ShpGeometry_2 = Input(_ShpGeometry: var[]..[])
python_script = Python(IN[0]=ShpGeometry, IN[1]=ShpGeometry_2)  # CPython3
# ---------- python_script.python (41 lines) ----------
# Shapely 2.0.1
# Durmus Bayram
import clr

try:
    from shapely.geometry.base import BaseGeometry
    from shapely.ops import shared_paths
    from shapely.geometry import MultiLineString
except ImportError:
    print("\n Please install Shapely package!")
    pass

def safe_shared_paths(g1, g2):
    if isinstance(g1, BaseGeometry) and isinstance(g2, BaseGeometry):
        try:
            result = shared_paths(g1, g2)
            return result
        except:
            return g1
    return g1

def get_shapely_shared_paths(a, b):
    if isinstance(a, list) and isinstance(b, list) and len(a) == len(b):
        return [get_shapely_shared_paths(item_a, item_b) for item_a, item_b in zip(a, b)]
    
    elif isinstance(a, list):
        return [get_shapely_shared_paths(item_a, b) for item_a in a]
    
    else:
        return safe_shared_paths(a, b)

if 'IN' in locals():
    input_a = IN[0]
    input_b = IN[1] if len(IN) > 1 else None
    
    if input_a is not None and input_b is not None:
        output = get_shapely_shared_paths(input_a, input_b)
    else:
        output = None

    OUT = output
# ----------------------------------------
ShpGeometry_3 = Output(python_script)  # "_ShpGeometry"
