# Dynamo custom node Shp_Triangulate.dyf (Dynamo 3.4.1.7055)
# category: Shapely.Geometry.Creates
# author: Durmus Bayryam
# It divides a polygon or a set of points into non-overlapping triangles. This process allows geometry to be broken down into smaller and simpler parts and is widely used in computational geometry.

ShpGeometry = Input(_ShpGeometry: var[]..[])
python_script = Python(IN[0]=ShpGeometry)  # CPython3
# ---------- python_script.python (49 lines) ----------
# Shapely 2.0.1
# Durmus Bayram
import clr

try:
    from shapely.geometry import Point as ShpPoint
    from shapely.geometry import LineString as ShpLineString
    from shapely.geometry import Polygon as ShpPolygon
    from shapely.geometry import LinearRing as ShpLinearRing
    from shapely.geometry import MultiPoint as ShpMultiPoint
    from shapely.geometry import MultiLineString as ShpMultiLineString
    from shapely.geometry import MultiPolygon as ShpMultiPolygon
    from shapely.geometry.base import BaseGeometry
    from shapely.ops import triangulate
except ImportError:
    print("\n Please install Shapely package!")
    pass

def shapely_generic_convex_hull(geom):
    if not isinstance(geom, BaseGeometry):
        return None
    return triangulate(geom)

def get_shapely_convex_hull(shapely_geometry, return_individual=False):
    
    if isinstance(shapely_geometry, list):
        if all(isinstance(x, ShpPoint) for x in shapely_geometry):
            return shapely_generic_convex_hull(ShpMultiPoint(shapely_geometry))
        
        return [get_shapely_convex_hull(item, return_individual) for item in shapely_geometry]
    
    if isinstance(shapely_geometry, (ShpMultiPoint, ShpMultiLineString, ShpMultiPolygon)):
        if return_individual:
            return [shapely_generic_convex_hull(g) for g in shapely_geometry.geoms]
        else:
            return shapely_generic_convex_hull(shapely_geometry)
    
    elif isinstance(shapely_geometry, BaseGeometry):
        return shapely_generic_convex_hull(shapely_geometry)
    
    else:
        return None

if 'IN' in locals():
    shp_input = IN[0]
    indiv_mode = IN[1] if len(IN) > 1 else False
    
    convex_hull_output = get_shapely_convex_hull(shp_input, indiv_mode)
    OUT = convex_hull_output
# ----------------------------------------
ShpGeometry_2 = Output(python_script)  # "_ShpGeometry"
