# Dynamo custom node Shp_Voronoi.dyf (Dynamo 3.4.1.7055)
# category: Shapely.Geometry.Creates
# author: Durmus Bayryam
# It generates a Voronoi diagram based on the given set of points. Each Voronoi cell represents the area belonging to the nearest point.

ShpPoint = Input(_ShpPoint: var[]..[])
Tolerance = Input(_Tolerance: var[]..[])
python_script = Python(IN[0]=ShpPoint, IN[1]=Tolerance)  # CPython3
# ---------- python_script.python (38 lines) ----------
# Shapely 2.0.1
# Durmus Bayram
import clr

try:
    from shapely.geometry import MultiPoint as ShpMultiPoint
    from shapely.geometry.base import BaseGeometry
    from shapely import voronoi_polygons
except ImportError:
    print("\n Please install Shapely package!")
    pass

def shapely_generic_voronoi(geom, tolerance, only_edges):
    if isinstance(geom, list):
        geom = ShpMultiPoint([g for g in geom if isinstance(g, BaseGeometry)])
    
    if not isinstance(geom, BaseGeometry):
        return None
        
    try:
        return voronoi_polygons(geom, tolerance=tolerance, only_edges=only_edges)
    except Exception as e:
        return None

def get_shapely_voronoi(shapely_geometry, tolerance, only_edges):
    if isinstance(shapely_geometry, list) and len(shapely_geometry) > 0 and isinstance(shapely_geometry[0], list):
        return [get_shapely_voronoi(item, tolerance, only_edges) for item in shapely_geometry]
    
    return shapely_generic_voronoi(shapely_geometry, tolerance, only_edges)

if 'IN' in locals():
    shp_input = IN[0] 
    tolerance_val = IN[1] if len(IN) > 1 and IN[1] is not None else 0.0
    only_edges_val = IN[2] if len(IN) > 2 and IN[2] is not None else False
    
    voronoi_output = get_shapely_voronoi(shp_input, tolerance_val, only_edges_val)
    
    OUT = voronoi_output
# ----------------------------------------
ShpGeometry = Output(python_script)  # "_ShpGeometry"
