# Dynamo custom node ShapelyTriangulate.dyf (Dynamo 2.10.1.3976)
# category: Shapely.Geometry

dynpoints = Input(_dynpoints: var[]..[])
python_script = Python(IN[0]=dynpoints)  # CPython3
# ---------- python_script.python (24 lines) ----------
import sys
import os
import clr

localapp = os.getenv(r'LOCALAPPDATA')
sys.path.append(os.path.join(localapp, r'python-3.8.3-embed-amd64\Lib\site-packages'))
import shapely.geometry as sg
import Autodesk.DesignScript.Geometry as adg
from shapely import normalize, Polygon , BufferJoinStyle , MultiPoint
from shapely.ops import triangulate


def spolygon (dynamo_polygons ):
    
    exterior_points = [(p.X, p.Y) for p in dynamo_polygons]
    multipoint = MultiPoint(exterior_points)

    return multipoint

shapely_polygons = spolygon(IN[0])
tri = triangulate(shapely_polygons)


OUT = tri
# ----------------------------------------
OUT = Output(python_script)
